# Grasshopper definition Panasonic Beard Trimmer ER-GB62.gh (Grasshopper 1.0.7)
# plug-ins: Telepathy

construct_point = ConstructPoint(XCoordinate=Slider(56.1, range=0..100), YCoordinate=0, ZCoordinate=0)
panel = Panel(construct_point)

point = Point(<point referenced from the Rhino model>)
panel_2 = Panel(point)
deconstruct = Deconstruct(Point=point)  # -> XComponent, YComponent, ZComponent
panel_3 = Panel(deconstruct.XComponent)
panel_4 = Panel(deconstruct.ZComponent)
panel_5 = Panel(deconstruct.YComponent)

number_slider = Slider(0, range=-80..80)

# ---- group: LONG
# mit Slider auf 16mm eingestellt liegt die Absolute Schnittlänge der Haare bei max. 33mm und min. 23mm
# mit Slider auf 26.33mm eingestellt liegt die Absolute Schnittlänge zwischen dem grosse Kamm (blau) und dem kleinen Kamm (schwarz)
number_slider_2 = Slider(26.33, range=-80..80)
number_slider_3 = Slider(5, range=-80..80)

# ---- group: LONG / CONNECTION
number_slider_4 = Slider(5.1, range=0..10)

# ---- group: LONG / SMOTHNESS
number_slider_5 = Slider(20, range=0..24)

# ---- group: LONG
number_slider_6 = Slider(1.5, range=0..30)
number_slider_7 = Slider(0, range=0..30)
number_slider_8 = Slider(7.7, range=0..30)

# ---- group: ZAND EXTRUSION - ARRAY
breath_zand_array = RemoteSender(Slider(46.5, range=0..80))
number_zand = RemoteSender(Slider(7, range=0..10))
smoothness_zand = RemoteSender(Slider(1, range=0..10))
thickness_zand = RemoteSender(Slider(1.6, range=0..10))

# ---- group: MIRROR POINT - LINE
construct_point_2 = ConstructPoint(XCoordinate="26.5", YCoordinate=0, ZCoordinate=0)
unit_y = UnitY(Factor=1)
line_sdl = LineSDL(Start=construct_point_2, Direction=unit_y, Length="26.5")

# ---- group: RAILS 1 2 3 / POS
number_slider_9 = Slider(30.8, range=-80..80)
number_slider_10 = Slider(23.2, range=0..80)
number_slider_11 = Slider(42, range=0..80)

# ---- group: RAILS 1 2 3 / DIM
number_slider_12 = Slider(3.5, range=0..80)
number_slider_13 = Slider(1, range=0..80)

number_slider_14 = Slider(0.8, range=0..80)
number_slider_15 = Slider(34, range=0..80)
number_slider_16 = Slider(2.8, range=0..80)

# ---- group: RAILS 1 2 3 / POS
number_slider_17 = Slider(38.6, range=0..80)
number_slider_18 = Slider(7.8, range=0..80)
number_slider_19 = Slider(9.7, range=0..80)

# ---- group: RAILS 1 2 3 / DIM
number_slider_20 = Slider(5.8, range=0..80)
number_slider_21 = Slider(22.8, range=0..80)
number_slider_22 = Slider(1, range=0..80)

# ---- group: RAILS 4
number_slider_23 = Slider(25, range=0..80)
number_slider_24 = Slider(13.5, range=0..80)
number_slider_25 = Slider(11.5, range=0..80)
number_slider_26 = Slider(2, range=0..80)

number_slider_27 = Slider(1.5, range=0..80)
number_slider_28 = Slider(9.5, range=0..80)

number_slider_29 = Slider(1, range=0..80)
number_slider_30 = Slider(2, range=0..80)

# ---- group: FLOOR
number_slider_31 = Slider(13.5, range=0..80)
number_slider_32 = Slider(2.6, range=0..80)
number_slider_33 = Slider(5, range=0..80)
number_slider_34 = Slider(10, range=0..80)
number_slider_35 = Slider(-0.075, range=-1..1)

# ---- group: WALLS
number_slider_36 = Slider(7, range=0..10)
number_slider_37 = Slider(2, range=0..80)
number_slider_38 = Slider(0.4, range=0..80)
number_slider_39 = Slider(1.5, range=0..80)
number_slider_40 = Slider(17, range=0..50)
number_slider_41 = Slider(3, range=0..10)
number_slider_42 = Slider(2, range=0..80)

# ---- group: RAILS 4 / fix z coordinate
panel_6 = Panel("5.4")

# ---- group: RAILS 4 / fix y coordinate
panel_7 = Panel("52.5")

# ----
addition = Addition(A=number_slider_2, B="17")
subtraction = Subtraction(A=addition, B="10")

# ---- group: SCHNITTLÄNGE
max_schnittlänge = Panel(addition)
min_schnittlänge = Panel(subtraction)

# ----
mirror_line = RemoteSender(line_sdl)
mirror_point = RemoteSender(construct_point_2)

# ---- group: ZAND_ARRAY_POSTION
mirror_point_2 = RemoteReceiver(mirror_point)
breath_zand_array_2 = RemoteReceiver(breath_zand_array)
deconstruct_2 = Deconstruct(Point=mirror_point_2)  # -> XComponent, YComponent, ZComponent
division = Division(A=breath_zand_array_2, B="2")
subtraction_2 = Subtraction(A=deconstruct_2.XComponent, B=division)
rot_zand_array = RemoteSender(Slider(-0.36, range=-0.5..-0.2))
x_zand_array = RemoteSender(subtraction_2)
y_zand_array = RemoteSender(Slider(14.6, range=0..80))
z_zand_array = RemoteSender(Slider(-17.6, range=-20..20))

# ----
line = Line(StartPoint=construct_point, EndPoint=point)

division_2 = Division(A=number_slider_25, B="2")
unit_x = UnitX(Factor=division_2)
negative = Negative(Value=unit_x)
yz_plane = YZPlane(Origin=Point(0, 0, 0))
area = Area(Geometry=yz_plane)  # -> Area, Centroid
evaluate_surface = EvaluateSurface(Surface=yz_plane, Point=area.Centroid)  # -> Point, Normal, UDirection, VDirection, Frame

# ---- group: POINTS - STRÄHL
number_slider_43 = Slider(0, range=0..80)
number_slider_44 = Slider(27.9, range=0..80)
number_slider_45 = Slider(24, range=0..80)
number_slider_46 = Slider(1, range=0..80)
number_slider_47 = Slider(6.5, range=0..80)
number_slider_48 = Slider(2.1, range=0..80)
number_slider_49 = Slider(7.5, range=0..80)
number_slider_50 = Slider(21.5, range=0..80)

# ---- group: ZAND / POINTS
unit_x_2 = UnitX(Factor=1)
pi = Pi(Factor=Slider(0.5, range=0..10))

# ---- group: ZAND EXTRUSION - ARRAY
smoothness_zand_2 = RemoteReceiver(smoothness_zand)
thickness_zand_2 = RemoteReceiver(thickness_zand)
breath_zand_array_3 = RemoteReceiver(breath_zand_array)
number_zand_2 = RemoteReceiver(number_zand)
unit_x_3 = UnitX(Factor=thickness_zand_2)
subtraction_3 = Subtraction(A=breath_zand_array_3, B=thickness_zand_2)
subtraction_4 = Subtraction(A=number_zand_2, B="1")
construct_domain = ConstructDomain(DomainStart=0, DomainEnd=subtraction_3)
range = Range(Domain=construct_domain, Steps=subtraction_4)
unit_x_4 = UnitX(Factor=range)

# ---- group: ZAND / POINTS
unit_z = UnitZ(Factor=number_slider_45)
xy_plane = XYPlane(Origin=Point(0, 0, 0))
number_slider_51 = Slider(80, range=0..80)
move = Move(Geometry=xy_plane, Motion=unit_z)  # -> Geometry, Transform
addition_2 = Addition(A=number_slider_43, B=number_slider_44)
plane_surface = PlaneSurface(Plane=move.Geometry, XSize=number_slider_51, YSize=number_slider_51)
construct_point_3 = ConstructPoint(XCoordinate=0, YCoordinate=number_slider_43, ZCoordinate=number_slider)
construct_point_4 = ConstructPoint(XCoordinate=0, YCoordinate=addition_2, ZCoordinate=number_slider)
construct_point_5 = ConstructPoint(XCoordinate=0, YCoordinate=Slider(20.8, range=0..80), ZCoordinate=Slider(11.8, range=0..80))

yz_plane_2 = YZPlane(Origin=construct_point_3)
circle = Circle(Plane=yz_plane_2, Radius=number_slider_50)
area_2 = Area(Geometry=circle)  # -> Area, Centroid

# ---- group: POINTS - STRÄHL (continued)
point_on_curve = PointOnCurve(circle, parameter=0.18)

# ---- group: ZAND / POINTS (continued)
angle_dimension_points = AngleDimensionPoints(Center=area_2.Centroid, PointA=point_on_curve, PointB=construct_point_4)  # -> AngleDimension, Center, PointA, PointB, DimensionLocation
deconstruct_3 = Deconstruct(Point=point_on_curve)  # -> XComponent, YComponent, ZComponent
vector_2pt = Vector2Pt(PointA=circle, PointB=point_on_curve, Unitize=False)  # -> Vector, Length

# ---- group: ZAND
addition_3 = Addition(A=number_slider_48, B=deconstruct_3.YComponent)
angel_zand = RemoteSender(angle_dimension_points.AngleDimension)

# ---- group: RAILS / RAIL 4
subtraction_5 = Subtraction(A=number_slider_25, B=number_slider_28)
division_3 = Division(A=number_slider_24, B="2")
division_4 = Division(A=number_slider_28, B="2")
division_5 = Division(A=subtraction_5, B="2")
unit_x_5 = UnitX(Factor=division_4)
unit_x_6 = UnitX(Factor=division_5)
unit_x_7 = UnitX(Factor=division_3)
negative_2 = Negative(Value=unit_x_5)
negative_3 = Negative(Value=unit_x_7)
unit_z_2 = UnitZ(Factor=number_slider_26)

# ---- group: FLOOR
division_6 = Division(A=number_slider_31, B="2")
unit_x_8 = UnitX(Factor=division_6)
unit_z_3 = UnitZ(Factor=number_slider_32)
negative_4 = Negative(Value=unit_z_3)
unit_y_2 = UnitY(Factor=number_slider_33)

# ---- group: ZAND_ARRAY_POSTION / ROTATION
rot_zand_array_2 = RemoteReceiver(rot_zand_array)
pi_2 = Pi(Factor=1)
multiplication = Multiplication(A=rot_zand_array_2, B=pi_2)

# ---- group: ZAND_ARRAY_POSTION / MOVE
x_zand_array_2 = RemoteReceiver(x_zand_array)
y_zand_array_2 = RemoteReceiver(y_zand_array)
z_zand_array_2 = RemoteReceiver(z_zand_array)
unit_y_3 = UnitY(Factor=y_zand_array_2)
negative_5 = Negative(Value=unit_y_3)
unit_x_9 = UnitX(Factor=x_zand_array_2)
unit_z_4 = UnitZ(Factor=z_zand_array_2)

# ---- group: RAIL 1
mirror_point_3 = RemoteReceiver(mirror_point)
deconstruct_4 = Deconstruct(Point=mirror_point_3)  # -> XComponent, YComponent, ZComponent
negative_6 = Negative(Value=number_slider_14)
negative_7 = Negative(Value=number_slider_15)
negative_8 = Negative(Value=number_slider_16)

# ---- group: RAILS / RAIL 3
division_7 = Division(A=number_slider_17, B="2")
addition_4 = Addition(A=number_slider_16, B=number_slider_19)
addition_5 = Addition(A=number_slider_9, B=number_slider_18)
subtraction_6 = Subtraction(A=deconstruct_4.XComponent, B=division_7)
subtraction_7 = Subtraction(A=number_slider_10, B=addition_4)
construct_point_6 = ConstructPoint(XCoordinate=subtraction_6, YCoordinate=addition_5, ZCoordinate=subtraction_7)
xy_plane_2 = XYPlane(Origin=construct_point_6)
negative_9 = Negative(Value=number_slider_20)
negative_10 = Negative(Value=number_slider_21)
negative_11 = Negative(Value=number_slider_22)
rectangle = Rectangle(Plane=xy_plane_2, XSize=negative_9, YSize=negative_10, Radius=0)  # -> Rectangle, Length
box_rectangle = BoxRectangle(Rectangle=rectangle.Rectangle, Height=negative_11)

# ---- group: LONG
unit_z_5 = UnitZ(Factor=number_slider_2)
negative_12 = Negative(Value=unit_z_5)
addition_6 = Addition(A=number_slider_2, B="99")
unit_x_10 = UnitX(Factor=1)
negative_13 = Negative(Value=addition_6)
pi_3 = Pi(Factor="1.5")
negative_14 = Negative(Value=number_slider_3)
unit_y_4 = UnitY(Factor=number_slider_4)
negative_15 = Negative(Value=number_slider_8)
negative_16 = Negative(Value=number_slider_6)
negative_17 = Negative(Value=number_slider_7)
unit_y_5 = UnitY(Factor=negative_15)
unit_y_6 = UnitY(Factor=negative_16)
unit_z_6 = UnitZ(Factor=negative_17)

# ---- group: RAILS
division_8 = Division(A=number_slider_11, B="2")

# ---- group: RAIL 1 (continued)
subtraction_8 = Subtraction(A=deconstruct_4.XComponent, B=division_8)
construct_point_7 = ConstructPoint(XCoordinate=subtraction_8, YCoordinate=number_slider_9, ZCoordinate=number_slider_10)
xy_plane_3 = XYPlane(Origin=construct_point_7)
rectangle_2 = Rectangle(Plane=xy_plane_3, XSize=negative_6, YSize=negative_7, Radius=0)  # -> Rectangle, Length
box_rectangle_2 = BoxRectangle(Rectangle=rectangle_2.Rectangle, Height=negative_8)

# ---- group: RAILS / RAIL 2
subtraction_9 = Subtraction(A=number_slider_16, B=number_slider_13)
subtraction_10 = Subtraction(A=number_slider_10, B=subtraction_9)
construct_point_8 = ConstructPoint(XCoordinate=subtraction_8, YCoordinate=number_slider_9, ZCoordinate=subtraction_10)
xy_plane_4 = XYPlane(Origin=construct_point_8)
negative_18 = Negative(Value=number_slider_12)
negative_19 = Negative(Value=number_slider_15)
negative_20 = Negative(Value=number_slider_13)
rectangle_3 = Rectangle(Plane=xy_plane_4, XSize=negative_18, YSize=negative_19, Radius=0)  # -> Rectangle, Length
box_rectangle_3 = BoxRectangle(Rectangle=rectangle_3.Rectangle, Height=negative_20)

# ---- group: ZAND / POINTS (continued)
rotate = Rotate(Vector=vector_2pt.Vector, Axis=unit_x_2, Angle=pi)

reverse = Reverse(Vector=rotate)
line_sdl_2 = LineSDL(Start=construct_point_4, Direction=vector_2pt.Vector, Length=number_slider_51)
surface_curve = SurfaceCurve(Surface=plane_surface, Curve=line_sdl_2)  # -> Curves, Points, UVPoints, Normals, Parameters, Tangents
construct_point_9 = ConstructPoint(XCoordinate=0, YCoordinate=addition_3, ZCoordinate=number_slider_49)
geometry = Geometry(surface_curve.Points)

line_sdl_3 = LineSDL(Start=surface_curve.Points, Direction=rotate, Length=number_slider_46)
end_points = EndPoints(Curve=line_sdl_3)  # -> Start, End
geometry_2 = Geometry(end_points.End)
magic_point = RemoteSender(geometry_2)

line_sdl_4 = LineSDL(Start=geometry_2, Direction=reverse, Length=number_slider_47)
end_points_2 = EndPoints(Curve=line_sdl_4)  # -> Start, End

# ---- group: ZAND
line_2 = Line(StartPoint=construct_point_3, EndPoint=construct_point_4)
line_3 = Line(StartPoint=construct_point_4, EndPoint=geometry)
line_4 = Line(StartPoint=construct_point_4, EndPoint=end_points_2.End)
line_5 = Line(StartPoint=geometry_2, EndPoint=end_points_2.End)
line_6 = Line(StartPoint=construct_point_9, EndPoint=point_on_curve)
line_7 = Line(StartPoint=point_on_curve, EndPoint=construct_point_3)
line_8 = Line(StartPoint=construct_point_5, EndPoint=construct_point_9)
line_9 = Line(StartPoint=geometry_2, EndPoint=construct_point_5)
magic_line = RemoteSender(line_3)
merge = Merge(Data1=line_2, Data2=line_4, Data3=line_5, Data4=line_9, Data5=line_8, Data6=line_6, Data7=line_7, Data8=line_3)  # -> flatten(Result)
join_curves = JoinCurves(Curves=merge, Preserve=False)
geometry_3 = Geometry(join_curves)

# ----
curve_zand = RemoteSender(geometry_3)

# ---- group: ZAND EXTRUSION - ARRAY (continued)
curve_zand_2 = RemoteReceiver(curve_zand)
fillet = Fillet(Curve=curve_zand_2, Radius=smoothness_zand_2)
boundary_surfaces = BoundarySurfaces(Edges=fillet)
extrude = Extrude(Base=boundary_surfaces, Direction=unit_x_3)
move_2 = Move(Geometry=extrude, Motion=unit_x_4)  # -> Geometry, Transform
geometry_4 = Geometry(move_2.Geometry)

# ----
brep_zand_array = RemoteSender(geometry_4)

# ---- group: ZAND_ARRAY_POSTION
brep_zand_array_2 = RemoteReceiver(brep_zand_array)

# ---- group: WALLS
unit_x_11 = UnitX(Factor=number_slider_42)
deconstruct_brep = DeconstructBrep(Brep=box_rectangle_3)  # -> Faces, Edges, Vertices
deconstruct_brep_2 = DeconstructBrep(Brep=box_rectangle)  # -> Faces, Edges, Vertices
list_item = ListItem(List=deconstruct_brep.Edges, Index=number_slider_36, Wrap=True)
list_item_2 = ListItem(List=deconstruct_brep_2.Edges, Index=number_slider_41, Wrap=True)
end_points_3 = EndPoints(Curve=list_item)  # -> Start, End
line_10 = Line(StartPoint=end_points_3.End, EndPoint=end_points_3.Start)
unit_x_12 = UnitX(Factor=number_slider_39)
loft = Loft(
    Curves=[line_10, list_item_2],
    Options={Adjust=False, Closed=False, LoftEnds=0, LoftSimp=0, LoftType=0, Rebuild=10, Refit=0.01})
area_3 = Area(Geometry=loft)  # -> Area, Centroid
negative_21 = Negative(Value=unit_x_12)
evaluate_surface_2 = EvaluateSurface(Surface=loft, Point=area_3.Centroid)  # -> Point, Normal, UDirection, VDirection, Frame
multiplication_2 = Multiplication(A=evaluate_surface_2.Normal, B=number_slider_38)
multiplication_3 = Multiplication(A=evaluate_surface_2.Normal, B=number_slider_37)
negative_22 = Negative(Value=multiplication_2)
list_item_3 = ListItem(List=deconstruct_brep_2.Edges, Index=Slider(11, range=0..100), Wrap=True)
flip_curve = FlipCurve(Curve=list_item_3)  # -> Curve, Flag

# ---- group: FLOOR
breath_zand_array_4 = RemoteReceiver(breath_zand_array)
unit_x_13 = UnitX(Factor=division_6)
division_9 = Division(A=breath_zand_array_4, B="2")
negative_23 = Negative(Value=unit_x_13)
unit_x_14 = UnitX(Factor=division_9)
unit_y_7 = UnitY(Factor=number_slider_34)
unit_z_7 = UnitZ(Factor=number_slider_32)
negative_24 = Negative(Value=unit_y_7)
negative_25 = Negative(Value=unit_z_7)
angel_zand_2 = RemoteReceiver(angel_zand)
pi_4 = Pi(Factor=number_slider_35)

# ---- group: LONG (continued)
move_3 = Move(Geometry=line_2, Motion=negative_12)  # -> Geometry, Transform
curve_middle = CurveMiddle(Curve=move_3.Geometry)
scale = Scale(Geometry=move_3.Geometry, Center=curve_middle, Factor="3")  # -> Geometry, Transform
end_points_4 = EndPoints(Curve=line_2)  # -> Start, End
line_sdl_5 = LineSDL(Start=end_points_4.Start, Direction=line_7, Length=addition_6)
line_sdl_6 = LineSDL(Start=end_points_4.End, Direction=line_4, Length=negative_13)
vector = Vector(line_sdl_6)
unit_vector = UnitVector(Vector=vector)
rotate_2 = Rotate(Vector=unit_vector, Axis=unit_x_10, Angle=pi_3)
curve_curve = CurveCurve(CurveA=scale.Geometry, CurveB=line_sdl_5)  # -> Points, ParamsA, ParamsB
multiplication_4 = Multiplication(A=rotate_2, B=Slider(-30.3, range=-80..80))
curve_curve_2 = CurveCurve(CurveA=scale.Geometry, CurveB=line_sdl_6)  # -> Points, ParamsA, ParamsB
move_4 = Move(Geometry=line_sdl_6, Motion=multiplication_4)  # -> Geometry, Transform
list_item_4 = ListItem(List=curve_curve.Points, Index=0, Wrap=True)
list_item_5 = ListItem(List=curve_curve_2.Points, Index=0, Wrap=True)
yz_plane_3 = YZPlane(Origin=construct_point_9)
line_sdl_7 = LineSDL(Start=end_points_4.Start, Direction=line_7, Length=negative_14)
line_sdl_8 = LineSDL(Start=end_points_4.End, Direction=line_4, Length=number_slider_3)
line_11 = Line(StartPoint=list_item_4, EndPoint=list_item_5)
end_points_5 = EndPoints(Curve=line_sdl_8)  # -> Start, End
end_points_6 = EndPoints(Curve=line_sdl_7)  # -> Start, End
curve_closest_point = CurveClosestPoint(Point=construct_point_9, Curve=scale.Geometry)  # -> Point, Parameter, Distance
distance = Distance(PointA=construct_point_9, PointB=curve_closest_point.Point)
panel_8 = Panel(distance)
circle_2 = Circle(Plane=yz_plane_3, Radius=distance)
line_12 = Line(StartPoint=list_item_4, EndPoint=end_points_6.End)
point_on_curve_2 = PointOnCurve(circle_2, parameter=0.86)
point_on_curve_3 = PointOnCurve(circle_2, parameter=0.803)
line_13 = Line(StartPoint=end_points_6.End, EndPoint=end_points_5.End)
line_14 = Line(StartPoint=list_item_5, EndPoint=end_points_5.End)
line_15 = Line(StartPoint=end_points_5.End, EndPoint=curve_closest_point.Point)
line_16 = Line(StartPoint=list_item_4, EndPoint=curve_closest_point.Point)
point_on_curve_4 = PointOnCurve(line_15, parameter=1)
move_5 = Move(Geometry=end_points_5.End, Motion=unit_y_4)  # -> Geometry, Transform
arc_3pt = Arc3Pt(PointA=curve_closest_point.Point, PointB=point_on_curve_3, PointC=point_on_curve_2)  # -> Arc, Plane, Radius
line_17 = Line(StartPoint=end_points_5.End, EndPoint=point_on_curve_2)
line_18 = Line(StartPoint=end_points_2.End, EndPoint=end_points_5.End)
line_19 = Line(StartPoint=list_item_4, EndPoint=end_points_6.End)
curve_middle_2 = CurveMiddle(Curve=line_19)
move_6 = Move(Geometry=list_item_4, Motion=unit_y_5)  # -> Geometry, Transform
move_7 = Move(Geometry=curve_middle_2, Motion=unit_y_6)  # -> Geometry, Transform
move_8 = Move(Geometry=move_7.Geometry, Motion=unit_z_6)  # -> Geometry, Transform
line_20 = Line(StartPoint=list_item_4, EndPoint=move_6.Geometry)
arc_3pt_2 = Arc3Pt(PointA=end_points_6.End, PointB=move_8.Geometry, PointC=move_6.Geometry)  # -> Arc, Plane, Radius
join_curves_2 = JoinCurves(Curves=[arc_3pt_2.Arc, line_20], Preserve=False)
join_curves_3 = JoinCurves(Curves=join_curves_2, Preserve=False)
fillet_2 = Fillet(Curve=join_curves_3, Radius=Slider(0, range=0..3))

# ---- group: LONG / CIRCLE
point_on_curve_5 = PointOnCurve(line_17, parameter=0.452)
point_on_curve_6 = PointOnCurve(circle_2, parameter=0.749)

# ---- group: LONG (continued)
arc_3pt_3 = Arc3Pt(PointA=point_on_curve_5, PointB=point_on_curve_4, PointC=point_on_curve_6)  # -> Arc, Plane, Radius
line_21 = Line(StartPoint=end_points_5.End, EndPoint=point_on_curve_5)
arc_3pt_4 = Arc3Pt(PointA=end_points_2.End, PointB=move_5.Geometry, PointC=point_on_curve_5)  # -> Arc, Plane, Radius
join_curves_4 = JoinCurves(Curves=[arc_3pt_4.Arc, arc_3pt_3.Arc], Preserve=False)
fillet_3 = Fillet(Curve=join_curves_4, Radius=number_slider_5)
merge_2 = Merge(Data1=line_13, Data2=fillet_2, Data3=line_16, Data5=fillet_3, Data6=line_18)  # -> flatten(Result)
join_curves_5 = JoinCurves(Curves=merge_2, Preserve=False)
panel_9 = Panel(merge_2)

# ----
curve_zand_long = RemoteSender(join_curves_5)

# ---- group: ZAND EXTRUSION - ARRAY (continued)
curve_zand_long_2 = RemoteReceiver(curve_zand_long)
fillet_4 = Fillet(Curve=curve_zand_long_2, Radius=smoothness_zand_2)
boundary_surfaces_2 = BoundarySurfaces(Edges=fillet_4)
extrude_2 = Extrude(Base=boundary_surfaces_2, Direction=unit_x_3)
move_9 = Move(Geometry=extrude_2, Motion=unit_x_4)  # -> Geometry, Transform

# ----
merge_3 = Merge(Data1=extrude_2, Data2=move_9.Geometry)
brep_zand_array_long = RemoteSender(merge_3)

# ---- group: ZAND_ARRAY_POSTION (continued)
brep_zand_array_long_2 = RemoteReceiver(brep_zand_array_long)
merge_4 = Merge(Data1=brep_zand_array_2, Data2=brep_zand_array_long_2)

# ---- group: ZAND_ARRAY_POSTION / ROTATION / ROTATION POINT
list_item_6 = ListItem(List=merge_4, Index=0, Wrap=True)
deconstruct_brep_3 = DeconstructBrep(Brep=list_item_6)  # -> Faces, Edges, Vertices
list_item_7 = ListItem(List=deconstruct_brep_3.Vertices, Index=Slider(2, range=0..10), Wrap=True)

# ---- group: ZAND_ARRAY_POSTION / ROTATION (continued)
yz_plane_4 = YZPlane(Origin=list_item_7)
rotate_3 = Rotate(Geometry=merge_4, Angle=multiplication, Plane=yz_plane_4)  # -> Geometry, Transform

# ---- group: ZAND_ARRAY_POSTION / MOVE (continued)
move_10 = Move(Geometry=rotate_3.Geometry, Motion=unit_x_9)  # -> Geometry, Transform
move_11 = Move(Geometry=move_10.Geometry, Motion=negative_5)  # -> Geometry, Transform
move_12 = Move(Geometry=move_11.Geometry, Motion=unit_z_4)  # -> Geometry, Transform

# ---- group: ZAND_ARRAY_POSTION (continued)
geometry_5 = Geometry(move_12.Geometry)

# ----
brep_pos_zand_array = RemoteSender(geometry_5)

# ---- group: STABILISATOR
brep_pos_zand_array_2 = RemoteReceiver(brep_pos_zand_array)
geometry_6 = Geometry(brep_pos_zand_array_2)
list_item_8 = ListItem(List=geometry_6, Index=Slider(3, range=0..100), Wrap=True)
deconstruct_brep_4 = DeconstructBrep(Brep=list_item_8)  # -> Faces, Edges, Vertices
list_item_9 = ListItem(List=deconstruct_brep_4.Faces, Index=Slider(1, range=0..80), Wrap=True)
area_4 = Area(Geometry=list_item_9)  # -> Area, Centroid
unit_y_8 = UnitY(Factor=Slider(0, range=-80..80))
scale_2 = Scale(Geometry=list_item_9, Center=area_4.Centroid, Factor="99")  # -> Geometry, Transform
move_13 = Move(Geometry=scale_2.Geometry, Motion=unit_y_8)  # -> Geometry, Transform
split_brep = SplitBrep(Brep=list_item_8, Cutter=move_13.Geometry)
unit_z_8 = UnitZ(Factor="99")
list_item_10 = ListItem(List=split_brep, Index=0, Wrap=True)  # -> Item, Item1
mirror_line_2 = RemoteReceiver(mirror_line)
unit_z_9 = UnitZ(Factor=1)
curve_middle_3 = CurveMiddle(Curve=mirror_line_2)
negative_26 = Negative(Value=unit_z_9)
scale_3 = Scale(Geometry=mirror_line_2, Center=curve_middle_3, Factor="10")  # -> Geometry, Transform
move_14 = Move(Geometry=scale_3.Geometry, Motion=negative_26)  # -> Geometry, Transform
extrude_3 = Extrude(Base=move_14.Geometry, Direction=unit_z_8)
brep_brep = BrepBrep(BrepA=list_item_10.Item1, BrepB=extrude_3)  # -> Curves, Points
end_points_7 = EndPoints(Curve=brep_brep.Curves)  # -> Start, End
breath_zand_array_5 = RemoteReceiver(breath_zand_array)
line_22 = Line(StartPoint=end_points_7.Start, EndPoint=end_points_7.End)
join_curves_6 = JoinCurves(Curves=[brep_brep.Curves, line_22], Preserve=False)
unit_x_15 = UnitX(Factor=1)
division_10 = Division(A=breath_zand_array_5, B="2")
boundary_surfaces_3 = BoundarySurfaces(Edges=join_curves_6)
multiplication_5 = Multiplication(A=division_10, B=unit_x_15)
extrude_4 = Extrude(Base=boundary_surfaces_3, Direction=multiplication_5)

# ----
mirror_point_4 = RemoteReceiver(mirror_point)
deconstruct_5 = Deconstruct(Point=list_item_7)  # -> XComponent, YComponent, ZComponent
deconstruct_6 = Deconstruct(Point=mirror_point_4)  # -> XComponent, YComponent, ZComponent
construct_point_10 = ConstructPoint(XCoordinate=deconstruct_6.XComponent, YCoordinate=deconstruct_5.YComponent, ZCoordinate=deconstruct_5.ZComponent)
unit_x_16 = UnitX(Factor=deconstruct_6.XComponent)
yz_plane_5 = YZPlane(Origin=construct_point_10)
magic_line_2 = RemoteReceiver(magic_line)
move_15 = Move(Geometry=magic_line_2, Motion=unit_x_16)  # -> Geometry, Transform
rotate_4 = Rotate(Geometry=move_15.Geometry, Angle=multiplication, Plane=yz_plane_5)  # -> Geometry, Transform
move_16 = Move(Geometry=rotate_4.Geometry, Motion=negative_5)  # -> Geometry, Transform
move_17 = Move(Geometry=move_16.Geometry, Motion=unit_z_4)  # -> Geometry, Transform
geometry_7 = Geometry(move_17.Geometry)

# ---- group: STABILISATOR
brep_pos_zand_array_3 = RemoteReceiver(brep_pos_zand_array)
list_item_11 = ListItem(List=brep_pos_zand_array_3, Index=0, Wrap=True)
deconstruct_brep_5 = DeconstructBrep(Brep=list_item_11)  # -> Faces, Edges, Vertices
list_item_12 = ListItem(List=deconstruct_brep_5.Faces, Index=Slider(9, range=0..10), Wrap=True)
area_5 = Area(Geometry=list_item_12)  # -> Area, Centroid
evaluate_surface_3 = EvaluateSurface(Surface=list_item_12, Point=area_5.Centroid)  # -> Point, Normal, UDirection, VDirection, Frame
plane_surface_2 = PlaneSurface(Plane=evaluate_surface_3.Frame, XSize=Domain(-10, 10), YSize=Domain(-10, 10))
scale_4 = Scale(Geometry=list_item_12, Center=area_5.Centroid, Factor="99")  # -> Geometry, Transform
unit_y_9 = UnitY(Factor=Slider(20.5, range=0..50))
move_18 = Move(Geometry=scale_4.Geometry, Motion=unit_y_9)  # -> Geometry, Transform
split_brep_2 = SplitBrep(Brep=extrude_4, Cutter=move_18.Geometry)
list_item_13 = ListItem(List=split_brep_2, Index=0, Wrap=True)  # -> Item, Item1

# ----
pos_magic_line = RemoteSender(geometry_7)

# ---- group: STABILISATOR
cap_holes = CapHoles(Brep=list_item_13.Item1)
geometry_8 = Geometry(cap_holes)

# ---- group: RAILS / RAIL 4 (continued)
pos_magic_line_2 = RemoteReceiver(pos_magic_line)
geometry_9 = Geometry(pos_magic_line_2)
vector_2 = Vector(geometry_9)
end_points_8 = EndPoints(Curve=geometry_9)  # -> Start, End
geometry_10 = Geometry(end_points_8.End)
line_sdl_9 = LineSDL(Start=geometry_10, Direction=vector_2, Length=number_slider_23)
end_points_9 = EndPoints(Curve=line_sdl_9)  # -> Start, End
line_sdl_10 = LineSDL(Start=end_points_9.End, Direction=vector_2, Length=number_slider_27)
end_points_10 = EndPoints(Curve=line_sdl_10)  # -> Start, End
move_19 = Move(Geometry=end_points_10.End, Motion=unit_x_5)  # -> Geometry, Transform
line_sdl_11 = LineSDL(Start=move_19.Geometry, Direction=vector_2, Length=number_slider_29)
extrude_5 = Extrude(Base=line_sdl_9, Direction=[unit_x_7, negative_3])
extrude_6 = Extrude(Base=line_sdl_10, Direction=[unit_x_5, negative_2])
end_points_11 = EndPoints(Curve=line_sdl_11)  # -> Start, End
yz_plane_6 = YZPlane(Origin=end_points_10.End)
brep_join = BrepJoin(Breps=extrude_5)  # -> Breps, Closed
brep_join_2 = BrepJoin(Breps=extrude_6)  # -> Breps, Closed
move_20 = Move(Geometry=end_points_11.End, Motion=unit_x_6)  # -> Geometry, Transform
line_23 = Line(StartPoint=move_19.Geometry, EndPoint=move_20.Geometry)
extrude_7 = Extrude(Base=brep_join.Breps, Direction=unit_z_2)
extrude_8 = Extrude(Base=brep_join_2.Breps, Direction=unit_z_2)
mirror = Mirror(Geometry=line_23, Plane=yz_plane_6)  # -> Geometry, Transform
loft_2 = Loft(
    Curves=[line_23, mirror.Geometry],
    Options={Adjust=False, Closed=False, LoftEnds=0, LoftSimp=0, LoftType=0, Rebuild=10, Refit=0.01})
extrude_9 = Extrude(Base=loft_2, Direction=unit_z_2)

# ---- group: RAILS / RAIL 4 / ZUS NUPSI
line_sdl_12 = LineSDL(Start=end_points_10.End, Direction=vector_2, Length=number_slider_29)
end_points_12 = EndPoints(Curve=line_sdl_12)  # -> Start, End
line_sdl_13 = LineSDL(Start=end_points_12.End, Direction=vector_2, Length=number_slider_30)
extrude_10 = Extrude(Base=line_sdl_13, Direction=[unit_x, negative])
brep_join_3 = BrepJoin(Breps=extrude_10)  # -> Breps, Closed
extrude_11 = Extrude(Base=brep_join_3.Breps, Direction=unit_z_2)

# ---- group: RAILS / RAIL 4 (continued)
merge_5 = Merge(Data1=extrude_7, Data2=extrude_8, Data3=extrude_9, Data4=extrude_11)

# ---- group: SMALL WALLS
unit_x_17 = UnitX(Factor=Slider(0.6, range=0..80))
deconstruct_brep_6 = DeconstructBrep(Brep=box_rectangle)  # -> Faces, Edges, Vertices
list_item_14 = ListItem(List=deconstruct_brep_6.Edges, Index=number_slider_41, Wrap=True)
end_points_13 = EndPoints(Curve=list_item_14)  # -> Start, End
line_24 = Line(StartPoint=end_points_13.End, EndPoint=end_points_13.Start)
unit_x_18 = UnitX(Factor=Slider(0.6, range=0..80))
loft_3 = Loft(
    Curves=[line_24, list_item_14],
    Options={Adjust=False, Closed=False, LoftEnds=0, LoftSimp=0, LoftType=0, Rebuild=10, Refit=0.01})
area_6 = Area(Geometry=loft_3)  # -> Area, Centroid
negative_27 = Negative(Value=unit_x_18)
evaluate_surface_4 = EvaluateSurface(Surface=loft_3, Point=area_6.Centroid)  # -> Point, Normal, UDirection, VDirection, Frame
multiplication_6 = Multiplication(A=evaluate_surface_4.Normal, B=number_slider_38)
multiplication_7 = Multiplication(A=evaluate_surface.Normal, B=number_slider_37)
negative_28 = Negative(Value=multiplication_6)

# ---- group: RAILS (continued)
geometry_11 = Geometry(geometry_10)
deconstruct_7 = Deconstruct(Point=geometry_11)  # -> XComponent, YComponent, ZComponent
addition_7 = Addition(A=deconstruct_7.ZComponent, B=number_slider_26)
subtraction_11 = Subtraction(A=addition_7, B=panel_6)
unit_z_10 = UnitZ(Factor=subtraction_11)
negative_29 = Negative(Value=unit_z_10)
move_21 = Move(Geometry=merge_5, Motion=negative_29)  # -> Geometry, Transform
deconstruct_brep_7 = DeconstructBrep(Brep=move_21.Geometry)  # -> Faces, Edges, flatten(Vertices)
deconstruct_8 = Deconstruct(Point=deconstruct_brep_7.Vertices)  # -> XComponent, YComponent, ZComponent
sort_list = SortList(Keys=deconstruct_8.YComponent, ValuesValuesA=deconstruct_8.YComponent)  # -> Keys, ValuesValuesA
list_item_15 = ListItem(List=sort_list.ValuesValuesA, Index=0, Wrap=True)  # -> Item1, Item
subtraction_12 = Subtraction(A=list_item_15.Item1, B=panel_7)

# ---- group: FLOOR (continued)
move_22 = Move(Geometry=geometry_10, Motion=negative_29)  # -> Geometry, Transform
move_23 = Move(Geometry=move_22.Geometry, Motion=unit_x_8)  # -> Geometry, Transform
move_24 = Move(Geometry=move_23.Geometry, Motion=negative_4)  # -> Geometry, Transform
move_25 = Move(Geometry=move_24.Geometry, Motion=unit_y_2)  # -> Geometry, Transform
box_2pt = Box2Pt(PointA=move_22.Geometry, PointB=move_25.Geometry, Plane=PlaneXY(0, 0, 0))

move_26 = Move(Geometry=move_25.Geometry, Motion=negative_23)  # -> Geometry, Transform
move_27 = Move(Geometry=move_26.Geometry, Motion=unit_x_14)  # -> Geometry, Transform
move_28 = Move(Geometry=move_27.Geometry, Motion=negative_24)  # -> Geometry, Transform
move_29 = Move(Geometry=move_28.Geometry, Motion=negative_25)  # -> Geometry, Transform
box_2pt_2 = Box2Pt(PointA=move_26.Geometry, PointB=move_29.Geometry, Plane=PlaneXY(0, 0, 0))
yz_plane_7 = YZPlane(Origin=move_25.Geometry)
rotate_5 = Rotate(Geometry=box_2pt_2, Angle=pi_4, Plane=yz_plane_7)  # -> Geometry, Transform

merge_6 = Merge(Data1=box_2pt, Data2=rotate_5.Geometry)
mirror_point_5 = RemoteReceiver(mirror_point)
yz_plane_8 = YZPlane(Origin=move_22.Geometry)
mirror_2 = Mirror(Geometry=merge_6, Plane=yz_plane_8)  # -> Geometry, Transform
merge_7 = Merge(Data1=merge_6, Data2=mirror_2.Geometry)
brep_join_4 = BrepJoin(Breps=merge_7)  # -> Breps, Closed
geometry_12 = Geometry(brep_join_4.Breps)

# ---- group: SMALL WALLS (continued)
deconstruct_brep_8 = DeconstructBrep(Brep=flatten(mirror_2.Geometry))  # -> Faces, flatten(Edges), Vertices
list_item_16 = ListItem(List=deconstruct_brep_8.Edges, Index=number_slider_40, Wrap=True)
move_30 = Move(Geometry=list_item_16, Motion=unit_x_17)  # -> Geometry, Transform
end_points_14 = EndPoints(Curve=move_30.Geometry)  # -> Start, End
line_25 = Line(StartPoint=end_points_13.Start, EndPoint=end_points_14.Start)
curve_middle_4 = CurveMiddle(Curve=line_25)
end_points_15 = EndPoints(Curve=move_30.Geometry)  # -> Start, End
line_26 = Line(StartPoint=end_points_13.End, EndPoint=end_points_15.Start)
curve_middle_5 = CurveMiddle(Curve=line_26)
move_31 = Move(Geometry=curve_middle_4, Motion=negative_27)  # -> Geometry, Transform
arc_3pt_5 = Arc3Pt(PointA=end_points_13.Start, PointB=move_31.Geometry, PointC=end_points_14.Start)  # -> Arc, Plane, Radius
move_32 = Move(Geometry=curve_middle_5, Motion=negative_27)  # -> Geometry, Transform
arc_3pt_6 = Arc3Pt(PointA=end_points_13.End, PointB=move_32.Geometry, PointC=end_points_15.Start)  # -> Arc, Plane, Radius
loft_4 = Loft(
    Curves=[arc_3pt_6.Arc, arc_3pt_5.Arc],
    Options={Adjust=False, Closed=False, LoftEnds=0, LoftSimp=0, LoftType=0, Rebuild=10, Refit=0.01})
extrude_12 = Extrude(Base=loft_4, Direction=multiplication_7)
move_33 = Move(Geometry=extrude_12, Motion=negative_28)  # -> Geometry, Transform; disabled

# ----
brep_floor = RemoteSender(geometry_12)
negative_30 = Negative(Value=subtraction_12)

# ---- group: RAILS (continued)
unit_y_10 = UnitY(Factor=negative_30)
move_34 = Move(Geometry=move_21.Geometry, Motion=unit_y_10)  # -> Geometry, Transform
geometry_13 = Geometry(move_34.Geometry)

# ---- group: RAILS / MIRROR
merge_8 = Merge(Data1=box_rectangle_2, Data2=box_rectangle_3, Data3=box_rectangle)
mirror_point_6 = RemoteReceiver(mirror_point)
yz_plane_9 = YZPlane(Origin=mirror_point_6)
mirror_3 = Mirror(Geometry=merge_8, Plane=yz_plane_9)  # -> Geometry, Transform
merge_9 = Merge(Data1=merge_8, Data2=mirror_3.Geometry, Data3=flatten(geometry_13))
geometry_14 = Geometry(merge_9)

# ----
brep_rails = RemoteSender(geometry_14)

# ---- group: WALLS (continued)
deconstruct_brep_9 = DeconstructBrep(Brep=flatten(mirror_2.Geometry))  # -> Faces, flatten(Edges), Vertices
list_item_17 = ListItem(List=deconstruct_brep_9.Edges, Index=number_slider_40, Wrap=True)
move_35 = Move(Geometry=list_item_17, Motion=unit_x_11)  # -> Geometry, Transform
end_points_16 = EndPoints(Curve=move_35.Geometry)  # -> Start, End
line_27 = Line(StartPoint=end_points_3.Start, EndPoint=end_points_16.End)
curve_middle_6 = CurveMiddle(Curve=line_27)
end_points_17 = EndPoints(Curve=move_35.Geometry)  # -> Start, End
line_28 = Line(StartPoint=end_points_3.End, EndPoint=end_points_17.Start)
curve_middle_7 = CurveMiddle(Curve=line_28)
move_36 = Move(Geometry=curve_middle_6, Motion=negative_21)  # -> Geometry, Transform
arc_3pt_7 = Arc3Pt(PointA=end_points_3.Start, PointB=move_36.Geometry, PointC=end_points_16.End)  # -> Arc, Plane, Radius
move_37 = Move(Geometry=curve_middle_7, Motion=negative_21)  # -> Geometry, Transform
arc_3pt_8 = Arc3Pt(PointA=end_points_3.End, PointB=move_37.Geometry, PointC=end_points_17.Start)  # -> Arc, Plane, Radius
loft_5 = Loft(
    Curves=[arc_3pt_8.Arc, arc_3pt_7.Arc],
    Options={Adjust=False, Closed=False, LoftEnds=0, LoftSimp=0, LoftType=0, Rebuild=10, Refit=0.01})
extrude_13 = Extrude(Base=loft_5, Direction=multiplication_3)
loft_6 = Loft(
    Curves=[flip_curve.Curve, arc_3pt_8.Arc],
    Options={Adjust=False, Closed=False, LoftEnds=0, LoftSimp=0, LoftType=0, Rebuild=10, Refit=0.01})

# ----
extrude_14 = Extrude(Base=loft_6, Direction=multiplication_3)
brep_join_5 = BrepJoin(Breps=[extrude_13, extrude_14])  # -> Breps, Closed

# ---- group: WALLS (continued)
move_38 = Move(Geometry=brep_join_5.Breps, Motion=negative_22)  # -> Geometry, Transform

# ---- group: CLOSE WALLS
deconstruct_brep_10 = DeconstructBrep(Brep=move_38.Geometry)  # -> Faces, Edges, Vertices
list_item_18 = ListItem(List=deconstruct_brep_10.Edges, Index=Slider(7, range=0..100), Wrap=True)
brep_pos_zand_array_4 = RemoteReceiver(brep_pos_zand_array)
list_item_19 = ListItem(List=brep_pos_zand_array_4, Index=Slider(0, range=0..100), Wrap=True)
deconstruct_brep_11 = DeconstructBrep(Brep=list_item_19)  # -> Faces, Edges, Vertices
list_item_20 = ListItem(List=deconstruct_brep_11.Faces, Index=Slider(46, range=0..100), Wrap=True)
area_7 = Area(Geometry=list_item_20)  # -> Area, Centroid
unit_y_11 = UnitY(Factor=Slider(-13, range=-20..20))
unit_z_11 = UnitZ(Factor=Slider(7.2, range=-20..20))
move_39 = Move(Geometry=area_7.Centroid, Motion=unit_y_11)  # -> Geometry, Transform
move_40 = Move(Geometry=move_39.Geometry, Motion=unit_z_11)  # -> Geometry, Transform
extrude_point = ExtrudePoint(Base=list_item_18, Point=move_40.Geometry)
unit_y_12 = UnitY(Factor=Slider(16, range=0..100))
unit_x_19 = UnitX(Factor=Slider(-10, range=-20..20))
extrude_15 = Extrude(Base=extrude_point, Direction=unit_y_12)
extrude_16 = Extrude(Base=list_item_20, Direction=unit_x_19)
solid_intersection = SolidIntersection(BrepsA=extrude_15, BrepsB=extrude_16)
geometry_15 = Geometry(solid_intersection)

# ---- group: MERGE
mirror_point_7 = RemoteReceiver(mirror_point)
merge_10 = Merge(Data1=move_38.Geometry, Data2=move_33.Geometry, Data3=geometry_8, Data4=geometry_15)  # -> flatten(Result)
yz_plane_10 = YZPlane(Origin=mirror_point_7)
mirror_4 = Mirror(Geometry=merge_10, Plane=yz_plane_10)  # -> Geometry, Transform
merge_11 = Merge(Data1=merge_10, Data2=mirror_4.Geometry)
brep_walls = RemoteSender(merge_11)

brep_pos_zand_array_5 = RemoteReceiver(brep_pos_zand_array)
brep_walls_2 = RemoteReceiver(brep_walls)
brep_rails_2 = RemoteReceiver(brep_rails)
brep_floor_2 = RemoteReceiver(brep_floor)
merge_12 = Merge(
    Data1=flatten(brep_pos_zand_array_5),
    Data2=flatten(brep_rails_2),
    Data3=flatten(brep_floor_2),
    Data4=flatten(brep_walls_2))

# ---- group: PREVIEW
geometry_16 = Geometry(merge_12)

# ---- group: INTERSECTION_RHINO_SHAPE
brep_join_6 = BrepJoin(Breps=geometry_16)  # -> Breps, Closed
geometry_17 = Geometry(<brep referenced from the Rhino model>)
geometry_18 = Geometry(brep_join_6.Breps)
solid_difference = SolidDifference(BrepsA=geometry_18, BrepsB=geometry_17)
geometry_19 = Geometry(solid_difference)
custom_preview = CustomPreview(Geometry=geometry_19, Material=ColourSwatch(SwatchColor=RGB(255, 255, 255)))

# ---- group: BREP TO MESH
mesh_brep = MeshBrep(
    Brep=geometry_19,
    Settings={GridMaxCount=0, GridMinCount=16, JaggedSeams=False, MaxEdgeLength=0, MinEdgeLength=0.0001, MinTolerance=0, Refine=True, RefineAngle=0, RelativeTolerance=0.65, SimplePlanes=True, Tolerance=0})
mesh_join = MeshJoin(Meshes=mesh_brep)
geometry_20 = Geometry(mesh_join)

# ---- group: EXPORT - STL
geometry_21 = Geometry(geometry_20)
