# Grasshopper definition Philips Series 5000.gh (Grasshopper 1.0.7)

number_slider = Slider(35, range=0..80)
number_slider_2 = Slider(24, range=0..80)
subtraction = Subtraction(A=number_slider, B=Slider(16, range=0..80))
subtraction_2 = Subtraction(A="0", B=Slider(15, range=0..80))
subtraction_3 = Subtraction(A=number_slider_2, B=Slider(12, range=0..80))
addition = Addition(A=subtraction_3, B=Slider(2, range=0..80))
construct_point = ConstructPoint(XCoordinate=0, YCoordinate=0, ZCoordinate=0)
construct_point_2 = ConstructPoint(XCoordinate=0, YCoordinate=number_slider, ZCoordinate=0)
construct_point_3 = ConstructPoint(XCoordinate=0, YCoordinate=subtraction, ZCoordinate=number_slider_2)
construct_point_4 = ConstructPoint(XCoordinate=0, YCoordinate=subtraction, ZCoordinate=subtraction_3)
construct_point_5 = ConstructPoint(XCoordinate=0, YCoordinate=subtraction_2, ZCoordinate=addition)

number_slider_3 = Slider(2, range=0..10)
number_slider_4 = Slider(44, range=0..80)
unit_x = UnitX(Factor=number_slider_3)
subtraction_4 = Subtraction(A=number_slider_4, B=number_slider_3)
construct_domain = ConstructDomain(DomainStart=0, DomainEnd=subtraction_4)
range = Range(Domain=construct_domain, Steps="6")
unit_x_2 = UnitX(Factor=range)

# ---- group: LÄNGE
number_slider_5 = Slider(50, range=0..80)

# ----
number_slider_6 = Slider(11.9, range=0..80)
number_slider_7 = Slider(1.5, range=0..80)
number_slider_8 = Slider(3.4, range=0..80)
number_slider_9 = Slider(5.3, range=0..80)
subtraction_5 = Subtraction(A=number_slider_9, B=number_slider_7)
construct_point_6 = ConstructPoint(XCoordinate=number_slider_7, YCoordinate=subtraction_5, ZCoordinate=0)
construct_point_7 = ConstructPoint(XCoordinate=number_slider_8, YCoordinate=number_slider_7, ZCoordinate=0)
construct_point_8 = ConstructPoint(XCoordinate=number_slider_8, YCoordinate=number_slider_9, ZCoordinate=0)
construct_point_9 = ConstructPoint(XCoordinate=number_slider_7, YCoordinate=number_slider_9, ZCoordinate=0)
construct_point_10 = ConstructPoint(XCoordinate=number_slider_8, YCoordinate=subtraction_5, ZCoordinate=0)
construct_point_11 = ConstructPoint(XCoordinate=0, YCoordinate=0, ZCoordinate=0)
construct_point_12 = ConstructPoint(XCoordinate=number_slider_7, YCoordinate=number_slider_7, ZCoordinate=0)
construct_point_13 = ConstructPoint(XCoordinate=0, YCoordinate=number_slider_6, ZCoordinate=0)
construct_point_14 = ConstructPoint(XCoordinate=number_slider_8, YCoordinate=0, ZCoordinate=0)
construct_point_15 = ConstructPoint(XCoordinate=number_slider_7, YCoordinate=number_slider_6, ZCoordinate=0)
line = Line(StartPoint=construct_point_11, EndPoint=construct_point_13)
line_2 = Line(StartPoint=construct_point_13, EndPoint=construct_point_15)
line_3 = Line(StartPoint=construct_point_14, EndPoint=construct_point_11)
line_4 = Line(StartPoint=construct_point_14, EndPoint=construct_point_7)
line_5 = Line(StartPoint=construct_point_7, EndPoint=construct_point_12)
line_6 = Line(StartPoint=construct_point_15, EndPoint=construct_point_9)
line_7 = Line(StartPoint=construct_point_8, EndPoint=construct_point_9)
line_8 = Line(StartPoint=construct_point_8, EndPoint=construct_point_10)
line_9 = Line(StartPoint=construct_point_10, EndPoint=construct_point_6)
line_10 = Line(StartPoint=construct_point_12, EndPoint=construct_point_6)
merge = Merge(
    Data1=line,
    Data2=line_2,
    Data3=line_6,
    Data4=line_7,
    Data5=line_8,
    Data6=line_9,
    Data7=line_10,
    Data8=line_5,
    Data9=line_4,
    Data10=line_3)
boundary_surfaces = BoundarySurfaces(Edges=merge)
unit_z = UnitZ(Factor=number_slider_5)
extrude = Extrude(Base=boundary_surfaces, Direction=unit_z)

subtraction_6 = Subtraction(A=number_slider_5, B=Slider(8.8, range=0..80))
unit_y = UnitY(Factor=Slider(3.1, range=0..80))
unit_y_2 = UnitY(Factor=Slider(0.8, range=0..80))
unit_z_2 = UnitZ(Factor=subtraction_6)
move = Move(Geometry=construct_point_15, Motion=unit_z_2)  # -> Geometry, Transform
negative = Negative(Value=unit_y)
negative_2 = Negative(Value=unit_y_2)
unit_z_3 = UnitZ(Factor=Slider(2.7, range=0..80))
move_2 = Move(Geometry=move.Geometry, Motion=negative_2)  # -> Geometry, Transform
move_3 = Move(Geometry=move_2.Geometry, Motion=negative)  # -> Geometry, Transform
negative_3 = Negative(Value=unit_z_3)
move_4 = Move(Geometry=[move_2.Geometry, move_3.Geometry], Motion=negative_3)  # -> Geometry, Transform
unit_x_3 = UnitX(Factor=Slider(0.9, range=0..80))
list_item = ListItem(List=move_4.Geometry, Index=0, Wrap=True)  # -> Item, Item1
number_slider_10 = Slider(0.8, range=0..80)
line_11 = Line(StartPoint=move_2.Geometry, EndPoint=move_3.Geometry)
line_12 = Line(StartPoint=move_2.Geometry, EndPoint=list_item.Item)
line_13 = Line(StartPoint=move_3.Geometry, EndPoint=list_item.Item1)
line_14 = Line(StartPoint=list_item.Item, EndPoint=list_item.Item1)
merge_2 = Merge(Data1=line_11, Data2=line_12, Data3=line_14, Data4=line_13)
unit_z_4 = UnitZ(Factor=number_slider_10)
unit_z_5 = UnitZ(Factor=number_slider_10)
move_5 = Move(Geometry=[line_11, line_14], Motion=unit_x_3)  # -> Geometry, Transform
join_curves = JoinCurves(Curves=merge_2, Preserve=False)
negative_4 = Negative(Value=unit_z_4)
list_item_2 = ListItem(List=move_5.Geometry, Index=0, Wrap=True)  # -> Item, Item1
move_6 = Move(Geometry=list_item_2.Item, Motion=negative_4)  # -> Geometry, Transform
move_7 = Move(Geometry=list_item_2.Item1, Motion=unit_z_5)  # -> Geometry, Transform
end_points = EndPoints(Curve=move_6.Geometry)  # -> Start, End
end_points_2 = EndPoints(Curve=move_7.Geometry)  # -> Start, End
line_15 = Line(StartPoint=end_points.End, EndPoint=end_points_2.End)
line_16 = Line(StartPoint=end_points.Start, EndPoint=end_points_2.Start)
merge_3 = Merge(Data1=move_6.Geometry, Data2=line_16, Data3=move_7.Geometry, Data4=line_15)
join_curves_2 = JoinCurves(Curves=merge_3, Preserve=False)
loft = Loft(
    Curves=[join_curves, join_curves_2],
    Options={Adjust=False, Closed=False, LoftEnds=0, LoftSimp=0, LoftType=0, Rebuild=10, Refit=0.01})
boundary_surfaces_2 = BoundarySurfaces(Edges=join_curves_2)

unit_y_3 = UnitY(Factor=Slider(2.8, range=0..80))
unit_x_4 = UnitX(Factor=Slider(2.4, range=0..80))
negative_5 = Negative(Value=unit_y_3)
move_8 = Move(Geometry=construct_point_13, Motion=unit_x_4)  # -> Geometry, Transform
move_9 = Move(Geometry=construct_point_15, Motion=negative_5)  # -> Geometry, Transform
move_10 = Move(Geometry=move_8.Geometry, Motion=negative_5)  # -> Geometry, Transform
geometry = Geometry(construct_point_15)
line_17 = Line(StartPoint=move_10.Geometry, EndPoint=move_9.Geometry)
line_18 = Line(StartPoint=move_9.Geometry, EndPoint=geometry)
line_19 = Line(StartPoint=geometry, EndPoint=move_8.Geometry)
line_20 = Line(StartPoint=move_8.Geometry, EndPoint=move_10.Geometry)
merge_4 = Merge(Data1=line_19, Data2=line_20, Data3=line_17, Data4=line_18)
subtraction_7 = Subtraction(A=number_slider_5, B=Slider(14, range=0..80))
boundary_surfaces_3 = BoundarySurfaces(Edges=merge_4)
unit_z_6 = UnitZ(Factor=subtraction_7)
extrude_2 = Extrude(Base=boundary_surfaces_3, Direction=unit_z_6)

boundary_surfaces_4 = BoundarySurfaces(Edges=join_curves)
merge_5 = Merge(Data1=loft, Data2=boundary_surfaces_2, Data3=boundary_surfaces_4)
unit_x_5 = UnitX(Factor=Slider(0.05, range=0..0.1))
boundary_volume = BoundaryVolume(Boundaries=merge_5)
negative_6 = Negative(Value=unit_x_5)
move_11 = Move(Geometry=merge_5, Motion=negative_6)  # -> Geometry, Transform
unit_x_6 = UnitX(Factor=Slider(0.8, range=-10..80))

line_21 = Line(StartPoint=construct_point_5, EndPoint=construct_point)
line_22 = Line(StartPoint=construct_point_3, EndPoint=construct_point_4)
line_23 = Line(StartPoint=construct_point_4, EndPoint=construct_point_5)

vector = Vector(line_23)
multiplication = Multiplication(A=vector, B=Slider(-0.25, range=-1..1))

vector_2 = Vector(line_21)
negative_7 = Negative(Value=vector_2)
multiplication_2 = Multiplication(A=vector_2, B=Slider(0.9, range=0..2))

move_12 = Move(Geometry=construct_point, Motion=multiplication_2)  # -> Geometry, Transform

distance = Distance(PointA=move_12.Geometry, PointB=construct_point_5)
round = Round(Number=distance)  # -> Nearest, Floor, Ceiling
subtraction_8 = Subtraction(A=round.Nearest, B="1")
addition_2 = Addition(A=round.Nearest, B="11")
panel = Panel(subtraction_8)
panel_2 = Panel(addition_2)

panel_3 = Panel(distance)
move_13 = Move(Geometry=construct_point_2, Motion=multiplication_2)  # -> Geometry, Transform
line_24 = Line(StartPoint=construct_point_5, EndPoint=move_12.Geometry)

line_25 = Line(StartPoint=move_12.Geometry, EndPoint=move_13.Geometry)
line_26 = Line(StartPoint=move_13.Geometry, EndPoint=construct_point_3)
merge_6 = Merge(Data1=line_25, Data2=line_26, Data3=line_22, Data4=line_23, Data5=line_24)

join_curves_3 = JoinCurves(Curves=merge_6, Preserve=False)
fillet = Fillet(Curve=join_curves_3, Radius=Slider(1, range=0..10))
boundary_surfaces_5 = BoundarySurfaces(Edges=fillet)
extrude_3 = Extrude(Base=boundary_surfaces_5, Direction=unit_x)
move_14 = Move(Geometry=extrude_3, Motion=unit_x_2)  # -> Geometry, Transform
geometry_2 = Geometry(move_14.Geometry)

unit_x_7 = UnitX(Factor=number_slider_4)
negative_8 = Negative(Value=Slider(0.4, range=-1..1))
move_15 = Move(Geometry=construct_point_5, Motion=unit_x_7)  # -> Geometry, Transform
vector_3 = Vector(line_23)
multiplication_3 = Multiplication(A=vector_3, B=negative_8)
move_16 = Move(Geometry=construct_point_5, Motion=multiplication_3)  # -> Geometry, Transform
move_17 = Move(Geometry=move_15.Geometry, Motion=multiplication_3)  # -> Geometry, Transform
multiplication_4 = Multiplication(A=vector_3, B=Slider(1, range=0..2))

move_18 = Move(Geometry=move_17.Geometry, Motion=multiplication)  # -> Geometry, Transform
move_19 = Move(Geometry=move_16.Geometry, Motion=multiplication)  # -> Geometry, Transform

line_27 = Line(StartPoint=move_15.Geometry, EndPoint=move_18.Geometry)
line_28 = Line(StartPoint=construct_point_5, EndPoint=move_19.Geometry)
line_29 = Line(StartPoint=move_18.Geometry, EndPoint=move_19.Geometry)
curve_middle = CurveMiddle(Curve=line_29)
move_20 = Move(Geometry=curve_middle, Motion=multiplication_4)  # -> Geometry, Transform
arc_3pt = Arc3Pt(PointA=move_15.Geometry, PointB=move_20.Geometry, PointC=construct_point_5)  # -> Arc, Plane, Radius
merge_7 = Merge(Data1=line_29, Data2=line_28, Data3=arc_3pt.Arc, Data4=line_27)
boundary_surfaces_6 = BoundarySurfaces(Edges=merge_7)

area = Area(Geometry=boundary_surfaces_6)  # -> Area, Centroid
scale = Scale(Geometry=boundary_surfaces_6, Center=area.Centroid, Factor=Slider(5, range=0..5))  # -> Geometry, Transform

negative_9 = Negative(Value=Slider(9, range=0..10))
unit_z_7 = UnitZ(Factor=Slider(7.5, range=0..10))
merge_8 = Merge(Data2=line_28, Data3=arc_3pt.Arc, Data4=line_27)
unit_y_4 = UnitY(Factor=negative_9)
join_curves_4 = JoinCurves(Curves=merge_8, Preserve=False)
negative_10 = Negative(Value=Slider(1, range=0..5))
offset_curve = OffsetCurve(Curve=join_curves_4, Distance=negative_10, Corners=1)
end_points_3 = EndPoints(Curve=offset_curve)  # -> Start, End

offset_curve_2 = OffsetCurve(Curve=join_curves_4, Distance=Slider(2, range=0..5), Corners=1)

end_points_4 = EndPoints(Curve=offset_curve_2)  # -> Start, End
move_21 = Move(Geometry=end_points_4.Start, Motion=unit_z_7)  # -> Geometry, Transform
move_22 = Move(Geometry=move_21.Geometry, Motion=unit_y_4)  # -> Geometry, Transform
line_30 = Line(StartPoint=end_points_4.Start, EndPoint=move_22.Geometry)
line_31 = Line(StartPoint=end_points_4.Start, EndPoint=end_points_3.Start)
line_32 = Line(StartPoint=end_points_4.End, EndPoint=end_points_3.End)
merge_9 = Merge(Data1=offset_curve_2, Data2=line_32, Data3=offset_curve, Data4=line_31)
join_curves_5 = JoinCurves(Curves=merge_9, Preserve=False)
boundary_surfaces_7 = BoundarySurfaces(Edges=join_curves_5)
extrude_along = ExtrudeAlong(Base=boundary_surfaces_7, Curve=line_30)

vector_4 = Vector(line_30)
negative_11 = Negative(Value=vector_4)
line_sdl = LineSDL(Start=end_points_4.Start, Direction=negative_11, Length=Slider(10, range=0..10))
extrude_along_2 = ExtrudeAlong(Base=boundary_surfaces_6, Curve=line_sdl)

geometry_3 = Geometry(extrude_along_2)
geometry_4 = Geometry(extrude_along)

geometry_5 = Geometry(extrude_2)
geometry_6 = Geometry(extrude)

deconstruct_brep = DeconstructBrep(Brep=geometry_5)  # -> Faces, Edges, Vertices
list_item_3 = ListItem(List=deconstruct_brep.Vertices, Index=0, Wrap=True)  # -> Item, Item1, Item2
unit_z_8 = UnitZ(Factor=Slider(5.1, range=0..80))
unit_y_5 = UnitY(Factor=Slider(1.7, range=0..80))
geometry_7 = Geometry(list_item_3.Item2)
negative_12 = Negative(Value=unit_z_8)
move_23 = Move(Geometry=geometry_7, Motion=unit_y_5)  # -> Geometry, Transform
move_24 = Move(Geometry=geometry_7, Motion=negative_12)  # -> Geometry, Transform
move_25 = Move(Geometry=move_23.Geometry, Motion=negative_12)  # -> Geometry, Transform
line_33 = Line(StartPoint=geometry_7, EndPoint=move_23.Geometry)
line_34 = Line(StartPoint=move_23.Geometry, EndPoint=move_25.Geometry)
line_35 = Line(StartPoint=move_24.Geometry, EndPoint=move_25.Geometry)
line_36 = Line(StartPoint=geometry_7, EndPoint=move_24.Geometry)
merge_10 = Merge(Data1=line_33, Data2=line_34, Data3=line_35, Data4=line_36)
boundary_surfaces_8 = BoundarySurfaces(Edges=merge_10)
unit_x_8 = UnitX(Factor=Slider(0.9, range=0..80))
extrude_4 = Extrude(Base=boundary_surfaces_8, Direction=unit_x_8)

geometry_8 = Geometry(extrude_4)
merge_11 = Merge(Data1=geometry_6, Data2=geometry_5, Data3=geometry_8, Data4=boundary_volume)

unit_z_9 = UnitZ(Factor=1)
unit_y_6 = UnitY(Factor=1)
geometry_9 = Geometry(curve_middle)
unit_z_10 = UnitZ(Factor=Slider(9, range=0..80))
move_26 = Move(Geometry=geometry_9, Motion=unit_z_9)  # -> Geometry, Transform
move_27 = Move(Geometry=geometry_9, Motion=unit_y_6)  # -> Geometry, Transform
unit_y_7 = UnitY(Factor=Slider(0, range=-10..80))
geometry_10 = Geometry(merge_11)
move_28 = Move(Geometry=geometry_10, Motion=unit_z_10)  # -> Geometry, Transform
yz_plane = YZPlane(Origin=Point(0, 0, 0))
move_29 = Move(Geometry=move_28.Geometry, Motion=unit_y_7)  # -> Geometry, Transform
pi = Pi(Factor=Slider(0.115, range=0..1))
plane_3pt = Plane3Pt(PointA=geometry_9, PointB=move_27.Geometry, PointC=move_26.Geometry)

move_30 = Move(Geometry=move_29.Geometry, Motion=unit_x_6)  # -> Geometry, Transform

rotate = Rotate(Geometry=move_30.Geometry, Angle=pi, Plane=yz_plane)  # -> Geometry, Transform
mirror = Mirror(Geometry=rotate.Geometry, Plane=plane_3pt)  # -> Geometry, Transform
merge_12 = Merge(Data1=rotate.Geometry, Data2=mirror.Geometry)

geometry_11 = Geometry(merge_12)
merge_13 = Merge(Data1=geometry_2, Data2=geometry_3, Data3=geometry_4, Data4=geometry_11)
brep_join = BrepJoin(Breps=merge_13)  # -> Breps, Closed
geometry_12 = Geometry(merge_13)
geometry_13 = Geometry(brep_join.Breps)
mesh_brep = MeshBrep(
    Brep=geometry_12,
    Settings={GridMaxCount=0, GridMinCount=16, JaggedSeams=False, MaxEdgeLength=0, MinEdgeLength=0.0001, MinTolerance=0, Refine=True, RefineAngle=0, RelativeTolerance=0.65, SimplePlanes=True, Tolerance=0})
mesh_join = MeshJoin(Meshes=mesh_brep)
geometry_14 = Geometry(mesh_join)
